# Grasshopper definition gh-gcode.gh (Grasshopper 1.0.4)
# Generates a centerline-programmed gcode file from input parameters and single or multiple curves.

feedrate_units_minute = Slider(660, range=0..1000)
retract_height = Slider(10, range=0..1000)
cut_depth = Slider(0, range=0..1000)
tolerance = Slider(1, range=0..100)
depth_per_cut = Slider(0, range=0..1000)
tool_diameter = Slider(0, range=0..1)
# GH-GCODE-GEN
# by Brett Ian Balogh
# Design Communications II Spring 2017
# Copyright
# Brett Ian Balogh
# CC-BY-NC-SA
units = ValueList({"INCH": "G20", "MM": "G21"}, selected="MM")
geometry = Curve([<curve referenced from the Rhino model> x7])
offset = ValueList({"INSIDE": “1”, "OUTSIDE": “2”, "NONE": “3”}, selected="OUTSIDE")
c_script = CSharpScript(G=geometry)  # -> out, L, C; inputs G: Curve
# ---------- c_script: C# ----------
if(G.Degree > 1){
	C = G;
	L = null;
}
else{
	L = G;
	C = null;
}
# ---------- end c_script ----------
divlength = DivideLength(Curve=c_script.C, Length=tolerance)  # -> Points, Tangents, Parameters
pline = PolyLine(Vertices=divlength.Points, Closed=Toggle(True))
offset_2 = Offset(Curve=pline, Distance=1, Plane=PlaneXY(0, 0, 0), Corners=1)
cp = ControlPoints(Curve=[c_script.L, pline])  # -> Points, Weights, Knots
path_mapper = PathMapper(cp.Points, source="{A;B;C}", target="{B}")
pline_2 = PolyLine(Vertices=path_mapper, Closed=False)  # -> flatten(Polyline)
end = EndPoints(Curve=pline_2)  # -> flatten(Start), flatten(End)
shift = ShiftList(List=end.End, Shift=1, Wrap=True)
pdecon = Deconstruct(Point=shift)  # -> XComponent, YComponent, ZComponent
pdecon_2 = Deconstruct(Point=end.Start)  # -> XComponent, YComponent, ZComponent
header = Panel("G0 G17 G90")
footer = Panel("M30")
pt = ConstructPoint(XCoordinate=pdecon_2.XComponent, YCoordinate=pdecon_2.YComponent, ZCoordinate=retract_height)
pt_2 = ConstructPoint(XCoordinate=pdecon.XComponent, YCoordinate=pdecon.YComponent, ZCoordinate=retract_height)
ln = Line(StartPoint=pt, EndPoint=pt_2)
ln_2 = Line(StartPoint=shift, EndPoint=pt_2)
ln_3 = Line(StartPoint=end.Start, EndPoint=pt)
panel = Panel("""0
1
2
3""")
weave = Weave(Pattern=panel, Stream0=pline_2, Stream1=ln_3, Stream2=ln, Stream3=ln_2, NullGaps=False)  # -> flatten(Weave)
join = JoinCurves(Curves=weave, Preserve=False)
cp_2 = ControlPoints(Curve=join)  # -> Points, Weights, Knots
pdecon_3 = Deconstruct(Point=cp_2.Points)  # -> XComponent, YComponent, ZComponent
item = ListItem(List=flatten(pdecon_3.XComponent), Index=0, Wrap=True)
item_2 = ListItem(List=flatten(pdecon_3.YComponent), Index=0, Wrap=True)
code = Expression(
    X=pdecon_3.XComponent,
    Y=pdecon_3.YComponent,
    Z=pdecon_3.ZComponent,
    F=feedrate_units_minute,
    Expression="Format(\"G1 X{0:0.000} Y{1:0.000} Z{2:0.000} F{3:0.0}\", X, Y, Z, F)")
code_2 = Expression(X=item, Y=item_2, Z=retract_height, Expression="Format(\"G0 X{0:0.000} Y{1:0.000} Z{2:0.000}\", X, Y, Z)")
move_to_origin_at_retract_height = Panel(code_2)
entwine = Entwine(
    Branch00=header,
    Branch01=units,
    Branch02=move_to_origin_at_retract_height,
    Branch03=code,
    Branch04=footer,
    FlattenInputs=True)
stream_contents = Panel(entwine)
